# Grasshopper definition geom.gh (Grasshopper 1.0.7)
# plug-ins: karambaGH

python = PythonScript()  # -> rhino_doc_dir
# ---------- python: Python ----------
import scriptcontext as sc
from os import path

rhino_doc_dir = path.abspath(path.dirname(sc.doc.Path))
# ---------- end python ----------
list = ValueList({"CRITICAL", "ERROR", "WARNING", "INFO", "DEBUG", "NOTSET"}, selected="DEBUG")

# ---- group: Import remote python modules
panel = Panel(python)
panel_2 = Panel("""numpy
scipy
numpy.linalg""")
ghpythonremote = GHPythonRemote(
    location="C:\Users\lux000021.dev\Anaconda3\envs\rhinoremote",
    run=Toggle(True),
    modules=panel_2,
    log_level=list,
    working_dir=panel)  # -> out, linked_modules, rpy; inputs run: Boolean, modules: list
# ---------- ghpythonremote: Python ----------
import inspect
import logging
from os import path
import sys
from time import sleep

import scriptcontext

import ghpythonremote
from ghpythonremote.connectors import GrasshopperToPythonRemote

local_log_level = getattr(logging, log_level, logging.WARNING)
logger = logging.getLogger("ghpythonremote")
logger.setLevel(local_log_level)
ch = logging.StreamHandler()
ch.setLevel(local_log_level)
formatter = logging.Formatter("%(levelname)s: %(name)s:\n%(message)s")
ch.setFormatter(formatter)
logger.handlers = []
logger.addHandler(ch)
logger = logging.getLogger("ghpythonremote.GH_to_python")

ROOT = path.abspath(path.dirname(inspect.getfile(ghpythonremote)))
rpyc_server_py = path.join(ROOT, "pythonservice.py")

# Set connection to CLOSED if this is the first run
# and initialize set of linked modules
try:
    remote_python_status
except NameError:
    remote_python_status = "CLOSED"
    lkd_modules = set()

# Wait for connection to connect or terminate
timer = 0
while remote_python_status == "CONNECTING" or remote_python_status == "CLOSING":
    sleep(1)
    timer += 1
    if timer == 10:
        try:
            gh2py_manager.__exit__(*sys.exc_info())
        except Exception:
            pass
        remote_python_status = "CLOSED"
        lkd_modules = set()
        raise RuntimeError(
            "Connection left in an inconsistent state and not returning. Reset "
            "everything."
        )

if run:
    if not remote_python_status == "OPEN":
        remote_python_status = "CONNECTING"
        gh2py_manager = GrasshopperToPythonRemote(
            rpyc_server_py,
            location=location,
            timeout=10,
            port=None,
            log_level=log_level,
            working_dir=working_dir,
        )
        gh2py = gh2py_manager.__enter__()
        remote_python_status = "OPEN"

    # Stuff that we can reach
    rpymod = gh2py.py_remote_modules  # A getter function for a named python module
    rpy = gh2py.connection  # Represents the remote instance root object
    scriptcontext.sticky["rpy"] = rpy
    # Add modules
    for mod in modules:
        try:
            scriptcontext.sticky[mod] = rpymod(mod)
            lkd_modules.add(mod)
        except ImportError:
            gh2py_manager.__exit__(*sys.exc_info())
            raise

elif not remote_python_status == "CLOSED":
    remote_python_status = "CLOSING"
    # Remove linked modules
    for mod in lkd_modules:
        del scriptcontext.sticky[mod]
    del scriptcontext.sticky["rpy"]
    gh2py_manager.__exit__(*sys.exc_info())
    lkd_modules = set()
    remote_python_status = "CLOSED"

# Change variable name because ghpython resets outputs to None before each run
linked_modules = lkd_modules

logger.info("GH to python connection is {}".format(remote_python_status))
# ---------- end ghpythonremote ----------
panel_3 = Panel(ghpythonremote.out)

# ----
python_2 = PythonScript(module_names=ghpythonremote.linked_modules)  # -> import_statements; inputs module_names: list
# ---------- python_2: Python ----------
import_statements = ["import scriptcontext as sc"]
for module_name in module_names:
    import_statements.append("{0} = sc.sticky['{0}']".format(module_name))

if len(module_names) == 0:
    import_statements = []
# ---------- end python_2 ----------
floor_height = Slider(3, range=0..10)
panel_4 = Panel("""{18.823758, 25.608127, 0}
{27.806624, 25.633253, 0}
{27.806624, 7.290618, 0}
{18.760941, 7.328309, 0}""")
panel_5 = Panel(python_2)
pt = Point(panel_4)
rec = Rectangle([{Plane=PlaneXY(21.11625588, 25.70163163, 0), Size=Domain2(u=-0.9942182436..0.9942182436, v=-0.2724540379..0.2724540379)}, {Plane=PlaneXY(27.8438484, 24.28220421, 0), Size=Domain2(u=-0.3489323644..0.3489323644, v=-0.9894383482..0.9894383482)}, {Plane=PlaneXY(27.85896518, 21.0071043, 0), Size=Domain2(u=-0.264999552..0.264999552, v=-0.5049103891..0.5049103891)}, {Plane=PlaneXY(27.80781532, 16.47264235, 0), Size=Domain2(u=-0.2276940405..0.2276940405, v=-2.424464054..2.424464054)}, {Plane=PlaneXY(27.81910128, 9.622167776, 0), Size=Domain2(u=-0.2476368605..0.2476368605, v=-1.912052288..1.912052288)}, {Plane=PlaneXY(25.79864007, 7.276889911, 0), Size=Domain2(u=-0.5143970595..0.5143970595, v=-0.2794255632..0.2794255632)}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])
panel_6 = Panel(rec)
pline = PolyLine(Vertices=pt, Closed=True)
Z = UnitZ(Factor=floor_height)
panel_7 = Panel("""Window
Wall
Wall
Window
Wall
Window
Wall
Window
Wall
Window
Wall
Wall
Window
Wall
Wall
Window
Wall
Window
Wall
Window
Wall
Window
Wall
Wall""")
move = Move(Geometry=pline, Motion=Z)  # -> Geometry, Transform

# ---- group: RDC enveloppe LBSs
split = SplitWithBreps(Curve=pline, Brep=rec)  # -> Curve, Points
explode = Explode(Curve=pline, Recursive=True)  # -> Segments, Vertices
explode_2 = Explode(Curve=split.Curve, Recursive=True)  # -> flatten(Segments), Vertices
is_it_structural = GhPythonScript(ps_and_os=explode_2.Segments, types=panel_7)  # -> no, yes, y; inputs ps_and_os: list, types: list
# ---------- is_it_structural: Python ----------
__author__ = "lux000006"
__version__ = "2020.11.26"

import rhinoscriptsyntax as rs

yes=[]
no=[]
y=0
x=0

for x in range(len(types)):
    if types[x] == str("Wall"):
        yes.append(ps_and_os[x])
    else:
        no.append(ps_and_os[x])
    x = x+1

y=x
# ---------- end is_it_structural ----------
floor_boundaries_pt = Point(flatten(explode.Vertices))
openings = Line(is_it_structural.no)
str_panel_lines = Line(flatten(is_it_structural.yes))

# ---- group: Use numpy, click to open and run
python_3 = PythonScript()  # -> out, a
# ---------- python_3: Python ----------
import scriptcontext
import ghpythonremote
np = scriptcontext.sticky['numpy']
rpy = scriptcontext.sticky['rpy']
# Do some numpy stuff
a = np.arange(15).reshape(3, 5)
print(a)
print(np.linalg.eig(np.arange(9).reshape(3, 3)))

# Fast way of sending data for numpy array creation
remote_range = ghpythonremote.deliver(rpy, range(1000))
array = np.array(remote_range)
# This is much slower
#b = np.array(range(1000))

# Get the array back as a local IronPython list
list = ghpythonremote.obtain(array.tolist())

# Get an error
#np.arange(9).reshape(4,3)
# ---------- end python_3 ----------
panel_8 = Panel(python_3.out)

# ---- group: Floor
number_slider = Slider(20, range=0..100)
matselect = MaterialSelectionKaramba3D(menu=[dropdown(4), dropdown(1)])
number_slider_2 = Slider(10, range=0..10)
number_slider_3 = Slider(10, range=0..10)
boundary = BoundarySurfaces(Edges=move.Geometry)
cross_section = CrossSectionKaramba3D(FamilyNameOfCrossSection="DefaultCroSec", Material=matselect, Height_cm=number_slider, mode="Shell - Const")
srfpt = SurfacePoints(Surface=boundary)  # -> Points, Weights, Greville, UCount, VCount
mesh_uv = MeshSurface(Surface=boundary, UCount=number_slider_2, VCount=number_slider_3, Overhang=True, Equalize=False)
meshtoshell = MeshToShellKaramba3D(Mesh=mesh_uv, Identifier="shell", CrossSection=cross_section, LimitDistance_m=0.005)  # -> Element, Points, Info
pt_2 = Point(meshtoshell.Points)
del = DelaunayMesh(Points=pt_2, Plane=PlaneXY(0, 0, 0))
mesh = Mesh(flatten(mesh_uv))
num = Number(Slider(2.7, range=0..10))
Z_2 = UnitZ(Factor=num)
loads = LoadsKaramba3D(Vector=Z_2, Mesh=mesh, LCase=0, mode="MeshLoad -Const.", menu=[buttons(on, off, off), buttons(on, on)])

# ---- group: BUCs
len = Length(Curve=str_panel_lines)
python_4 = GhPythonScript(x=len)  # -> out, pitch, nBUCs; inputs x: list
# ---------- python_4: Python ----------
__author__ = "lux000021"
__version__ = "2021.06.14"

import rhinoscriptsyntax as rs
import math

pitch = []
nBUCs = []

for i in x:
    temp = math.ceil((i-2*0.120-0.6)/(0.120+0.6))
    print((i-2*0.120-0.6)/(0.120+0.6))
    pitch.append(i/(temp+1))
    if temp < 1:
        temp = 1
    nBUCs.append(temp)
# ---------- end python_4 ----------
divide = DivideCurve(Curve=str_panel_lines, Count=python_4.nBUCs, Kinks=False)  # -> Points, Tangents, Parameters
panel_9 = Panel("1200")
panel_10 = Panel("5")
lower_bucs_points = Point(simplify(divide.Points))
panel_11 = Panel(python_4.pitch)
Z_3 = UnitZ(Factor=floor_height)
matprops = MaterialPropertiesKaramba3D(
    FamilyOfMaterial="wood",
    Name="c30",
    YoungsModulusKNCm2Dir1=panel_9,
    YoungsModulusKNCm2Dir2="400",
    InPlaneShearModulus_kN_cm2="75",
    InPlaneLateralContractionCoefficient="0",
    TransverseShearModulusKNCm2Dir1=panel_10,
    TransverseShearModulusKNCm2Dir2=panel_10,
    SpecificWeight_kN_m3="5.2",
    CoefficientOfThermalExpansion1CDir1=1e-05,
    CoefficientOfThermalExpansion1CDir2=1e-05,
    YieldStrengthKNCm2Dir1=23.5,
    YieldStrengthKNCm2Dir2=23.5,
    mode="Orthotropic")
move_2 = Move(Geometry=lower_bucs_points, Motion=Z_3)  # -> Geometry, Transform
cross_section_2 = CrossSectionKaramba3D(
    FamilyNameOfCrossSection="DefaultCroSec",
    Material=matprops,
    Height_cm="12",
    UpperFlangeWidth_cm="12",
    LowerFlangeWidth_cm="12",
    mode="Trapezoid")
upper_bucs_points = Point(move_2.Geometry)
posts = Line(StartPoint=lower_bucs_points, EndPoint=upper_bucs_points)
supp = SupportKaramba3D(PosInd=lower_bucs_points, menu=[buttons(on, on, on, on, on, on)])
linetobeam = LineToBeamKaramba3D(Line=flatten(posts), Identifier="BUCs", CrossSection=cross_section_2, New=True, Remove=True, LimitDistance_m=0.005)  # -> Element, Points, Info

# ---- group: Lintels
lintels_height_cm = Panel("12")
Z_4 = UnitZ(Factor=floor_height)
addition = Addition(A=number_slider, B=lintels_height_cm)
cross_section_3 = CrossSectionKaramba3D(
    FamilyNameOfCrossSection="DefaultCroSec",
    Material=matprops,
    Height_cm=addition,
    UpperFlangeWidth_cm="6",
    LowerFlangeWidth_cm="6",
    mode="Trapezoid")
move_3 = Move(Geometry=openings, Motion=Z_4)  # -> Geometry, Transform
linetobeam_2 = LineToBeamKaramba3D(Line=move_3.Geometry, Identifier="lintels", CrossSection=cross_section_3, New=True, Remove=True, LimitDistance_m=0.005)  # -> Element, Points, Info
line_load_of_facade_openings_kn_m = Panel("1.51")
Z_5 = UnitZ(Factor=line_load_of_facade_openings_kn_m)
neg = Negative(Value=Z_5)
loads_2 = LoadsKaramba3D(Vector=neg, BeamIdentifiers="lintels", LCase=0, mode="Uniform Line", menu=[buttons(off, on, off)])

# ---- group: Upper BUCs point mesh
python_script_to_get_edges = GhPythonScript(x=number_slider_2, y=number_slider_3, z=meshtoshell.Points)  # -> out, a, edge1, edge2, edge3, edge4; inputs z: list
# ---------- python_script_to_get_edges: Python ----------
__author__ = "lux000021"
__version__ = "2021.06.14"

import rhinoscriptsyntax as rs
import scriptcontext
import ghpythonremote
np = scriptcontext.sticky['numpy']
rpy = scriptcontext.sticky['rpy']

u = int(x)
v = int(y)

edge1 = []
edge2 = []
edge3 = []
edge4 = []

for i in range(v+1):
    edge1.append(i)
    edge2.append((u+1)*(v+1)-1-i)

for i in range(u+1):
    edge3.append(i*(v+1))
    edge4.append((i+1)*(v+1)-1)

print(edge1)
print(edge2)
print(edge3)
print(edge4)
# ---------- end python_script_to_get_edges ----------
item = ListItem(List=meshtoshell.Points, Index=[python_script_to_get_edges.edge1, python_script_to_get_edges.edge2], Wrap=True)

# ----
ungroup = Ungroup(Group=item)  # -> flatten(Objects)
pt_3 = Point(item)
supp_2 = SupportKaramba3D(PosInd=item, menu=[buttons(on, on, on, on, on, on)])
panel_12 = Panel(pt_3)
rdpoints = RemoveDuplicatePointsKaramba3D(Point=[upper_bucs_points, meshtoshell.Points], LimitDistance=0.005)  # -> flatten(OutPoint), Info, Indexes
del_2 = DelaunayMesh(Points=rdpoints.OutPoint, Plane=PlaneXY(0, 0, 0))
meshtoshell_2 = MeshToShellKaramba3D(Mesh=del_2, LimitDistance_m=0.005)  # -> Element, Points, Info
load = LoadKaramba3D([loads, loads_2])
element = ElementKaramba3D([linetobeam.Element, meshtoshell_2.Element, linetobeam_2.Element])
support = SupportKaramba3D(supp)

# ---- group: Karamba FEM anlysis
assemble = AssembleModelKaramba3D(Elem=flatten(element), Support=flatten([support, supp_2]), Load=load, LimitDistance_m=0.005)  # -> Model, Info, Mass_kg, CenterOfGravity
analyze = AnalyzeKaramba3D(Model=assemble.Model)  # -> CalculatedModel, MaximumDisplacement_cm, ResultingForceOfGravity_kN, ElasticEnergy_kNm
modelview = ModelViewKaramba3D(Model=analyze.CalculatedModel, ResultFactors=1, ResultCase=-1)  # -> Model, DeformedMesh, DeformedAxes, DeformedModel
beamview = BeamViewKaramba3D(Model=analyze.CalculatedModel)  # -> Model, MeshesOfRenderedBeams, DeformedBeamAxes, LegendColors, LegendTags
shellview = ShellViewKaramba3D(Model=analyze.CalculatedModel, IndexOfLayer=0)  # -> Model, MeshesOfRenderedShells, LegendColors, LegendTags

# ----
galapagos = Galapagos(fitness=python_5)

# ---- group: Paramètres auxiliaires
layers_of_posts_n = Slider(3, range=2..3)
insulation_width_resolution = Panel("0.17")
l2 = Panel("0.120")
h = Panel("0.040")
a = Panel("0.030")
buc_lines = Line()

# ---- group: assign gene to traverse pitch
int = Integer()
traverses_pitches = GhPythonScript(gene_pool=int)  # -> wall_number; inputs gene_pool: list, vectors: list, lines_length: Int32, xprod: list
# ---------- traverses_pitches: Python ----------
__author__ = "lux000006"
__version__ = "2020.09.30"

import rhinoscriptsyntax as rs
import math

# for each LBS, see if it is coplanar with the previous LBS and assigns a line a the traverse gene pool accordingly

trav_pitches = []
wall_number = []
x = 0
y = 0


for x in range(lines_length):
    if x == 0:
        trav_pitches.append(gene_pool[y])
        wall_number.append(y)
        y=y+1
    else:
        if 0<xprod[x-1]<0.2:
            trav_pitches.append(gene_pool[y-1])
            wall_number.append(y-1)
        else:
            trav_pitches.append(gene_pool[y])
            wall_number.append(y)
            y=y+1
# ---------- end traverses_pitches ----------
a_resolution = Multiplication(B=insulation_width_resolution)
addition_2 = Addition(A=a_resolution, B=l2)

# ---- group: Paramètres auxiliaires (continued)
l1 = Number(addition_2)

# ---- group: Eurocode check
b_res_force = BeamResultantForcesKaramba3D(
    AnalyzedModel=analyze.CalculatedModel,
    BeamIdentifiers="BUCs",
    LoadCase=-1,
    MaximumProbingDistance_m=-1,
    NumberOfProbingPointsPerElement=3)  # -> AnalyzedModel, flatten(NormalForce_kN), ResultantBendingMoment_kNm, ResultantShearForce_kN
lng = ListLength(List=flatten(upper_bucs_points))
bucs_force_without_lintel_forces_split = SplitList(List=b_res_force.NormalForce_kN, Index=lng)  # -> simplify(ListA), ListB
lng_2 = ListLength(List=lower_bucs_points)  # -> flatten(Length)
k_mod_longterm = Panel("0.7")
f_rack_d_ml = Panel("1.3")
k_i_k_roll = Panel("50")
panel_13 = Panel(lng_2)
f_m_k = Panel("24")
partition = PartitionList(List=bucs_force_without_lintel_forces_split.ListA, Size=lng_2)  # -> simplify(flatten(Chunks))
f_v_r_k = Panel("1")
gamma_m = Panel("1.3")
e_005 = Panel("7400")
f_c_0_k = Panel("21")
k_i_k_slip = Panel("6165")
f_i_limit = GhPythonScript(
    p=python_4.pitch,
    l1=flatten(l1),
    l2=l2,
    l=floor_height,
    n=layers_of_posts_n,
    h=h,
    a=a,
    E_005=e_005,
    E_0_mean=panel_9,
    f_m_k=f_m_k,
    f_c_0_k=f_c_0_k,
    f_v_r_k=f_v_r_k,
    K_i_k_slip=k_i_k_slip,
    G_r_k=panel_10,
    k_mod_longterm=k_mod_longterm,
    gamma_M=gamma_m,
    F_c_0_d=partition,
    F_rack_d_ml=f_rack_d_ml,
    posts_per_panel=lng_2)  # -> simplify(F_i_limit), simplify(ULS_trans), simplify(panels_struc_param), simplify(Joint_Shear_ULS); inputs n: Int32, F_c_0_d: list, posts_per_panel: Int32
# ---------- f_i_limit: Python ----------
__author__ = "lux000006"
__version__ = "2020.09.21"

import rhinoscriptsyntax as rs
import math
import time
start = time.clock()
#... repeat the operation several times
total_ms = time.clock() - start


x = 0
F_i_limit = []


ULS_trans = 0
p = p*1000 #[mm]
l1 = l1*1000 #[mm]
l2 = l2*1000 #[mm]
l = l*1000 #[mm]
h= h*1000
a = a*1000
E_0_mean = E_0_mean*10
f_m_d = 0
M_y_d = 0
w_d = 0
K_i_k = 0

G_r_k = G_r_k*10 #[N/mm]
n_posts = 1 #//number of sets of posts per linear meter"""
u_plus = math.ceil((l-l2)/l1+1) #//number of set of traverses"""
xL = n+n-1; #// number of layers"""
K_i_k_roll = G_r_k*l2*l2/a #//[N/mm] tranverse slip modulus of a traverse, due to rolling shear stiffness"""
A_tot = h*l2*n #//area of a set of posts"""
h3_tot_n = 0 #/equivalent structural height of the set of posts"""

exp1 = math.pow((n*h+(n-1)*a),3)
exp2 = math.pow(((n-2)*h+(n-1)*a),3)
exp3 = math.pow(((n-2)*h+(n-3)*a),3)
exp4 = math.pow(((n-4)*h+(n-3)*a),3)
exp5 = math.pow(((n-4)*h+(n-5)*a),3)
exp6 = math.pow(((n-6)*h+(n-5)*a),3)
exp7 = math.pow(((n-6)*h+(n-7)*a),3)


if (n == 0): h3_tot_n = 0
if (n == 1): h3_tot_n = exp1 
if (n == 2): h3_tot_n = exp1 - exp2 
if (n == 3): h3_tot_n = exp1 - exp2 + exp3 
if (n == 4): h3_tot_n = exp1 - exp2 + exp3 - exp4 
if (n == 5): h3_tot_n = exp1 - exp2 + exp3 - exp4 + exp5 
if (n == 6): h3_tot_n = exp1 - exp2 + exp3 - exp4 + exp5 - exp6 
if (n == 7): h3_tot_n = exp1 - exp2 + exp3 - exp4 + exp5 - exp6 + exp7 

I_tot = l2*h3_tot_n/12 #//equivalent moment of inertia of a set of posts"""
lambda_1 = math.sqrt(12)*l1/h
eta = 1.0 #//slipping factor"""

lambdax = l*math.sqrt(A_tot/I_tot) #slenderness ratio corresponding to bending (about the y-axis)
lambda_ef_y = math.sqrt(lambdax*lambdax+eta*n/2*lambda_1*lambda_1) #effective slenderness ratio corresponding to bending about the y-axis
lambda_rel_y = lambda_ef_y/math.pi*math.sqrt(f_c_0_k/E_005) #relative slenderness ratio corresponding to bending about the y-axis
beta_c = 0.2; #straightness factor (eq.6.29)
k_y = 0.5*(1+beta_c*(lambda_rel_y-0.3)+lambda_rel_y*lambda_rel_y) #instability factor
k_c_y = 1/(k_y+math.sqrt(k_y*k_y-lambda_rel_y*lambda_rel_y)) #compression instability factor of built-up column
f_c_0_d = f_c_0_k*k_mod_longterm/gamma_M #design compression strength

kcy_fc0d = k_c_y*f_c_0_d  #compressive strength of one set of posts
P_cr_d = kcy_fc0d*A_tot*n_posts/1000 #critical load, (max admissible) by the one-meter-long panel

for x in range(posts_per_panel):
    F_i_limit.append(P_cr_d)
    sigma_c_0_d = F_c_0_d[x]/A_tot #vertical compressive stress in the built-up column

dr_vertical_buckling_pressure = sigma_c_0_d/kcy_fc0d


#3.2.2. Case 1/2: λrel,y < 0.3 (impossible)
#3.2.3. Case 2/2: λrel,y > 0.3 (systematic)

k_m = 0.7 #factor considering re-distribution of bending stresses in a cross-section
f_m_d = f_m_k*k_mod_longterm/gamma_M #design bending strength of the material
M_y_d = w_d*l*l/8 #[N.mm] max transverse bending moment from transverse wind pressure
#calculation of sigma_m_y_d for design check (Annex B enhanced with the gamma method)
#calculation of (EI)ef as the sum of (EI)ef_i accross the layers
i = 1 #layer identifier
EI_ef_i = 0 #effective bending stiffness of the i layer
EI_ef = 0 #effective bending stiffness of one set of posts
A_i = 0 #cross-sectional area of the member of the layer i
I_i = 0 #moment of inertia around the y axis of the member of the layer i
gamma_i = 0; #gamma factor of the layer i
E_i_mean = E_0_mean; #mean longitudinal stiffness of the layer i (currently it is constant, it could vary in future products)
s_i = l1 #distance between the "packs" or traverses --> l1
K_i_k = 1/(1/K_i_k_slip+1/K_i_k_roll); #total characteristic slip of a traverse or "connector"
a_i = 0 #distance from the centroid of the layer i to the centroid of the entire cross section

i = 1
A_i = 0
I_i = 0
gamma_i = 0
a_i = 0
sigma_i_d = 0 #normal stress in the layer i
sigma_m_i_d = 0 #normal bending stress in the layer i
sigma_m_y_i_d = 0 #total bending stress in the layer i
sigma_m_y_d = 0 #maximum total bending stress across all layer

while (i <= xL):
    if (i % 2 == 0): #if i is even
        A_i = 0
        I_i = 0
    else:
        A_i = h*l2
        I_i = l2*math.pow(h,3)/12;
    if (i == (xL+1)/2): #if i is the middle layer
        gamma_i = 1
    elif (i %2 == 0): #if i is even
        gamma_i = 0
    else: #if i is NOT even AND NOT the middle layer
        gamma_i = math.pow((1 + (math.pi*math.pi*E_i_mean*A_i*s_i/(K_i_k*l*l))),-1)
    a_i = abs((n-i)*(h/2+a/2))
    
    EI_ef_i = E_i_mean*I_i + gamma_i*E_i_mean*A_i*a_i*a_i #general formula;
    EI_ef = EI_ef + EI_ef_i #progressively summing up EI_ef_i of every layer to form EI_ef
    
    sigma_i_d = gamma_i*E_i_mean*a_i*M_y_d/n_posts/EI_ef
    sigma_m_i_d = 0.5*E_i_mean*h*M_y_d/n_posts/EI_ef
    sigma_m_y_i_d = sigma_i_d + sigma_m_i_d
    if (sigma_m_y_i_d > sigma_m_y_d):
        sigma_m_y_d = sigma_m_y_i_d
    i=i+1

dr_transverse_wind = sigma_m_y_d/f_m_d; #intermediate design ratio about transverse wind bending pressure sigma m,y,d / f m,y,d

n_travs = math.ceil(l/l1)
n_joints = (n-1)*2*n_posts*n_travs
I_z_ml = h*math.pow(l2,3)/12*n_posts
M_joint_d = F_rack_d_ml*1000/n_joints*l
sigma_m_z_d = M_joint_d/I_z_ml*l2/2

dr_racking_bending = sigma_m_z_d/f_m_d #intermediate design ratio about transverse wind bending pressure sigma m,y,d / f m,y,d

DR_tranverse_ULS = dr_vertical_buckling_pressure + dr_transverse_wind + k_m*sigma_m_z_d/f_m_d #design ratio for transverse ULS (vertical load, direct wind pressure and coming soon: joint racking)


ULS_trans = []
for x in range(posts_per_panel):
    ULS_trans.append(DR_tranverse_ULS)

panels_struc_param = []
panels_struc_param.append(l2/1000)
panels_struc_param.append(h/1000)
panels_struc_param.append(a/1000)
panels_struc_param.append(n)
panels_struc_param.append(p/1000)
panels_struc_param.append(l1/1000)



#JointShear ULS--------------------------------------

Joint_Shear_ULS=[]
Vcd=0
Tcd=0
Tcdpack=0
Vmd=0
DR_Joint_Shear_ULS=0


for x in range(posts_per_panel):
    if lambda_ef_y<30:
        Vcd=F_c_0_d[x]*1000/(120*k_c_y)
    elif lambda_ef_y<60:
        Vcd=F_c_0_d[x]*1000*lambda_ef_y/(3600*k_c_y)
    else:
        Vcd=F_c_0_d[x]*1000/(60*k_c_y)
    Tcd=Vcd*l1/(a+h)
    if (n == 1): Tcdpack=0
    if (n == 2): Tcdpack=Tcd
    if (n == 3): Tcdpack=0.5*Tcd
    if (n == 4): Tcdpack=0.4*Tcd
    Vmd=0 #w_d*l/2
    DR_Joint_Shear_ULS=((Tcdpack+Vmd)/(f_v_r_k*l2*l2*k_mod_longterm/gamma_M))
    Joint_Shear_ULS.append(DR_Joint_Shear_ULS)
# ---------- end f_i_limit ----------

# ---- group: Fitness Marge Surplus / Format Forces
neg_2 = Negative(Value=bucs_force_without_lintel_forces_split.ListA)
multiplication = Multiplication(A=neg_2, B=100)
round = Round(Number=multiplication)  # -> Nearest, Floor, Ceiling
division = Division(A=round.Nearest, B=100)

# ---- group: Fitness Marge Surplus / Format Capcité Portante
flatten = FlattenTree(Tree=f_i_limit.F_i_limit, Path="{0}")
multiplication_2 = Multiplication(A=flatten, B=-1)
neg_3 = Negative(Value=multiplication_2)
multiplication_3 = Multiplication(A=neg_3, B=100)
round_2 = Round(Number=multiplication_3)  # -> Nearest, Floor, Ceiling
division_2 = Division(A=round_2.Nearest, B=100)

# ----
uls_trans = Panel(f_i_limit.ULS_trans)

# ---- group: Fitness Marge Surplus / Fitness
flatten_2 = FlattenTree(Tree=f_i_limit.F_i_limit, Path="{0}")
multiplication_4 = Multiplication(B="-1")
subtraction = Subtraction(A=multiplication_4, B=flatten_2)
python_5 = GhPythonScript(F_i_limit=flatten_2, F_i=multiplication_4, substrac=subtraction)  # -> Fitness; inputs F_i_limit: list, F_i: list, substrac: list
# ---------- python_5: Python ----------
__author__ = "lux000006"
__version__ = "2020.09.23"

import rhinoscriptsyntax as rs
import math

Fitness = 0;

max_substrac = 0
for x in range(len(F_i)):
    Fitness = Fitness + abs(substrac[x]);
    if F_i > 0:
        if substrac[x] > max_substrac:
            max_substrac = substrac[x];
Fitness = Fitness + max_substrac;
# ---------- end python_5 ----------
round_3 = Round(Number=python_5)  # -> Nearest, Floor, Ceiling
fitness = Panel(round_3.Nearest)

# ----
liste_des_capacités_portantes_de_chaque = Panel(f_i_limit.F_i_limit)  # "Liste des capacités portantes de chaque élément"

# ---- group: Fitness Marge Surplus / Calculate Surplus
neg_4 = Negative(Value=subtraction)
multiplication_5 = Multiplication(A=neg_4, B=100)
round_4 = Round(Number=multiplication_5)  # -> Nearest, Floor, Ceiling
division_3 = Division(A=round_4.Nearest, B=100)

# ---- group: Fitness Marge Surplus / Calculate Marge
division_4 = Division(A=division_2, B=neg_2)
multiplication_6 = Multiplication(A=division_4, B=10)
round_5 = Round(Number=multiplication_6)  # -> Nearest, Floor, Ceiling
division_5 = Division(A=round_5.Nearest, B=10)

# ----
panel_structural_parameters = Panel(f_i_limit.panels_struc_param)
joint_shear_uls = Panel(f_i_limit.Joint_Shear_ULS)
marge = Panel(division_5)
surplus = Panel(division_3)

# ---- group: size the traverse-pitch gene-pool
vec = Vector(str_panel_lines)
unit = UnitVector(Vector=vec)
cull_i = CullIndex(List=unit, Indices=0, Wrap=True)
xprod = CrossProduct(VectorA=cull_i, VectorB=unit, Unitize=False)  # -> Vector, Length
vlen = VectorLength(Vector=xprod.Vector)

# ----
lng_3 = ListLength(List=vec)

# ---- group: size the traverse-pitch gene-pool (continued)
traverses_pitches_2 = GhPythonScript(vectors=vec, lines_length=lng_3, xprod=vlen)  # -> flatten(y); inputs vectors: list, lines_length: Int32, xprod: list
# ---------- traverses_pitches_2: Python ----------
__author__ = "lux000006"
__version__ = "2020.09.30"

import rhinoscriptsyntax as rs
import math

# for each LBS, see if it is coplanar with the previous LBS and assigns a line a the traverse gene pool accordingly


x = 0
y = 0


for x in range(lines_length):
    if x == 0:
        y=y+1
    else:
        if 0<xprod[x-1]<0.2:
            y=y
        else:
            y=y+1
# ---------- end traverses_pitches_2 ----------
